# Grasshopper definition fabform.gh (Grasshopper 1.0.7)
# plug-ins: MosquitoAudio2, EdiTree

# ----
# Play audio file and draw waveform
toggle = BooleanToggle(False)
path = FilePath("C:\Users\baharmon\Downloads\digital-culture-seminar-master\digital-culture-seminar-master\poems\markovified-poem.mp3")
play = AudioPlay(AudioFile=path, Boolean=toggle)
audiowave = AudioWave(AudioFile=path, XOffset=Slider(0.1, range=0..0.25), Skip=Slider(4500, range=0..5000))  # -> Peak, Points, Length
intcrv = Interpolate(Vertices=audiowave.Points, Degree=3, Periodic=False, KnotStyle=1)  # -> Curve, Length, Domain

# ----
# Divide waveform and loft as a surface
number_slider = Slider(7, range=0..100)
dom = ConstructDomain(DomainStart=0, DomainEnd=expr("x-1", number_slider))
range = Range(Domain=dom, Steps=expr("x-1", number_slider))
divide_list = DivideList(List=audiowave.Points, Number=number_slider)  # -> Chunk, Remainder
vec = VectorXYZ(XComponent=expr("(x*-1)+0.01", graft(0)), YComponent=graft(range), ZComponent=0)  # -> Vector, Length
intcrv_2 = Interpolate(Vertices=divide_list.Chunk, Degree=3, Periodic=False, KnotStyle=1)  # -> Curve, Length, Domain
move = Move(Geometry=intcrv_2.Curve, Motion=vec.Vector)  # -> Geometry, Transform
movetoplane = MoveToPlane(Geometry=move.Geometry, Plane=PlaneYZ(0, 0, 0), Above=True, Below=True)  # -> Geometry, Transform
crv = Curve(movetoplane.Geometry)
loft = Loft(Curves=flatten(crv), Options={Adjust=False, Closed=False, LoftEnds=0, LoftSimp=0, LoftType=0, Rebuild=10, Refit=0.01})

# ----
# Slice and extrude surface
number_slider_2 = Slider(2, range=0..10)
multiplication = Multiplication(A=Slider(12, range=0..100), B=number_slider_2)
scale = Scale(Geometry=loft, Center=Point(0, 0, 0), Factor=multiplication)  # -> Geometry, Transform
contour = Contour(
    Shape=scale.Geometry,
    Point=Point(0, 0.0006274138079, -0.0006274138079),
    Direction=Vector(0, 45.00062741, -0.0006274138079),
    Distance=Slider(1.5, range=0..10))
vec_2 = VectorXYZ(XComponent=0, YComponent=Slider(0.75, range=0..10), ZComponent=0)  # -> Vector, Length
extr = Extrude(Base=contour, Direction=vec_2.Vector)
vdis = VectorDisplay(Anchor=Point(0, 0.0006274138079, -0.0006274138079), Vector=vec_2.Vector)
vec_3 = VectorXYZ(XComponent=0, YComponent=0, ZComponent=Slider(6, range=0..10))  # -> Vector, Length
extr_2 = Extrude(Base=extr, Direction=vec_3.Vector)

panel = Panel("Arrange slices")
viewer = ParamViewer(extr_2)
lng = ListLength(List=viewer)
multiplication_2 = Multiplication(A=lng, B=Slider(12, range=0..100))
dom_2 = ConstructDomain(DomainStart=0, DomainEnd=multiplication_2)
range_2 = Range(Domain=dom_2, Steps=lng)
pt = ConstructPoint(XCoordinate=0, YCoordinate=graft(range_2), ZCoordinate=0)
vec_4 = VectorXYZ(XComponent=0, YComponent=graft(range_2), ZComponent=0)  # -> Vector, Length
move_2 = Move(Geometry=extr_2, Motion=vec_4.Vector)  # -> Geometry, Transform
pl = ConstructPlane(Origin=pt, XAxis=Vector(0, 1, 0), YAxis=Vector(0, 0, 1))
rotate = Rotate(Geometry=move_2.Geometry, Angle=degrees(90), Plane=pl)  # -> Geometry, Transform
movetoplane_2 = MoveToPlane(Geometry=rotate.Geometry, Plane=PlaneXY(0, 0, 0), Above=True, Below=True)  # -> Geometry, Transform
project = Project(Geometry=movetoplane_2.Geometry, Plane=PlaneXY(0, 0, 0))  # -> Geometry, Transform
debrep = DeconstructBrep(Brep=project.Geometry)  # -> Faces, Edges, Vertices
crv_2 = Curve(debrep.Edges)

# ----
# Layout slices on stock
number_slider_3 = Slider(48, range=0..100)
Y = UnitY(Factor=Slider(10, range=-36..36))
integer_division = IntegerDivision(A=lng, B=Slider(7, range=0..100))
move_3 = Move(Geometry=crv_2, Motion=Y)  # -> Geometry, Transform
rectangle = Rectangle(Plane=PlaneXY(0, 0, 0), XSize=number_slider_3, YSize=Slider(96, range=0..100), Radius=0)  # -> Rectangle, Length
divide_list_2 = DivideList(List=move_3.Geometry, Number=integer_division)  # -> Chunk, Remainder
