# Grasshopper definition waveform.gh (Grasshopper 0.9.76)
# plug-ins: MosquitoAudio2, EdiTree

# ----
# Play audio file and draw waveform
toggle = BooleanToggle(False)
path = FilePath("C:\Users\baharmon\Downloads\digital-culture-seminar-master\digital-culture-seminar-master\poems\markovified-poem.mp3")
play = AudioPlay(AudioFile=path, Boolean=toggle)
audiowave = AudioWave(AudioFile=path, XOffset=Slider(0.1, range=0..0.25), Skip=Slider(4500, range=0..5000))  # -> Peak, Points, Length
intcrv = Interpolate(Vertices=audiowave.Points, Degree=3, Periodic=False, KnotStyle=1)  # -> Curve, Length, Domain

# ----
# Divide waveform and loft as a surface
number_slider = Slider(7, range=0..100)
dom = ConstructDomain(DomainStart=0, DomainEnd=expr("x-1", number_slider))
range = Range(Domain=dom, Steps=expr("x-1", number_slider))
divide_list = DivideList(List=audiowave.Points, Number=number_slider)  # -> Chunk, Remainder
vec = VectorXYZ(XComponent=expr("(x*-1)+0.01", graft(0)), YComponent=graft(range), ZComponent=0)  # -> Vector, Length
intcrv_2 = Interpolate(Vertices=divide_list.Chunk, Degree=3, Periodic=False, KnotStyle=1)  # -> Curve, Length, Domain
move = Move(Geometry=intcrv_2.Curve, Motion=vec.Vector)  # -> Geometry, Transform
movetoplane = MoveToPlane(Geometry=move.Geometry, Plane=PlaneYZ(0, 0, 0), Above=True, Below=True)  # -> Geometry, Transform
crv = Curve(movetoplane.Geometry)
loft = Loft(Curves=flatten(crv), Options={Adjust=False, Closed=False, LoftEnds=0, LoftSimp=0, LoftType=0, Rebuild=10, Refit=0.01})

# ----
# Divide surface into contours and extrude
number_slider_2 = Slider(0.05, range=0..1)
contour = Contour(
    Shape=loft,
    Point=Point(0, 0.0006274138079, -0.0006274138079),
    Direction=Vector(0, 45.00062741, -0.0006274138079),
    Distance=Slider(0.1, range=0..1))
vec_2 = VectorXYZ(XComponent=0, YComponent=number_slider_2, ZComponent=0)  # -> Vector, Length
extr = Extrude(Base=contour, Direction=vec_2.Vector)
vdis = VectorDisplay(Anchor=Point(0, 0.0006274138079, -0.0006274138079), Vector=vec_2.Vector)
vec_3 = VectorXYZ(XComponent=0, YComponent=0, ZComponent=Slider(0.2, range=0..1))  # -> Vector, Length
extr_2 = Extrude(Base=extr, Direction=vec_3.Vector)
